# Grasshopper definition directsolarhours_v2_windows_doors.gh (Grasshopper 1.0.7)

# ----
# Get coordinates of spatial location
panel = Panel("C:\ProgramData\Solemma\Common\WeatherData\EPW\DNK_Copenhagen.061800_IWEC.epw")
importloc = LBImportLocation(epw_file=panel)  # -> location; plug-in component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
panel_2 = Panel(importloc)

# ----
# Set time-related parameters
panel_3 = Panel("3")
analysisperiod = LBAnalysisPeriod(start_month=panel_3, start_day="21", start_hour="0", end_month=panel_3, end_day="21", end_hour="23", timestep="2")  # -> period, hoys, dates; plug-in component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

# ----
# Compute SunPath
# over current scene
# for given latitude &
# day of year at a 30min
# temporal resolution
sunpath = LBSunPath(location=importloc, hoys=analysisperiod.hoys, scale=1)  # -> report, vectors, altitudes, azimuths, hoys, sun_pts, analemma, daily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; plug-in component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

# ----
# Add target geometries for computing direct sun hours
pipeline = GeometryPipeline(
    GroupByLayer=False,
    GroupByType=False,
    IncludeHidden=True,
    IncludeLocked=True,
    LayerFilter="Fönster",
    NameFilter="*",
    SublayerFiltering=True,
    TypeFilter=1073741848)
pipeline_2 = GeometryPipeline(
    GroupByLayer=False,
    GroupByType=False,
    IncludeHidden=True,
    IncludeLocked=True,
    LayerFilter="Dörr",
    NameFilter="*",
    SublayerFiltering=True,
    TypeFilter=1073741848)
merge = Merge(Data1=pipeline, Data2=pipeline_2)
geometry = Brep(merge)

# ----
# Add geometries obstructing sunlight access
pipeline_3 = GeometryPipeline(
    GroupByLayer=False,
    GroupByType=False,
    IncludeHidden=True,
    IncludeLocked=True,
    LayerFilter="ny_fasad",
    NameFilter="*",
    SublayerFiltering=True,
    TypeFilter=1073741848)
pipeline_4 = GeometryPipeline(
    GroupByLayer=False,
    GroupByType=False,
    IncludeHidden=True,
    IncludeLocked=True,
    LayerFilter="surroundings_sol",
    NameFilter="*",
    SublayerFiltering=True,
    TypeFilter=1073741848)
pipeline_5 = GeometryPipeline(
    GroupByLayer=False,
    GroupByType=False,
    IncludeHidden=True,
    IncludeLocked=True,
    LayerFilter="Tak",
    NameFilter="*",
    SublayerFiltering=True,
    TypeFilter=1073741848)
pipeline_6 = GeometryPipeline(
    GroupByLayer=False,
    GroupByType=False,
    IncludeHidden=True,
    IncludeLocked=True,
    LayerFilter="surroundings",
    NameFilter="*",
    SublayerFiltering=True,
    TypeFilter=1073741848)
pipeline_7 = GeometryPipeline(
    GroupByLayer=False,
    GroupByType=False,
    IncludeHidden=True,
    IncludeLocked=True,
    LayerFilter="ny_fasad_2",
    NameFilter="*",
    SublayerFiltering=True,
    TypeFilter=1073741848)
pipeline_8 = GeometryPipeline(
    GroupByLayer=False,
    GroupByType=False,
    IncludeHidden=True,
    IncludeLocked=True,
    LayerFilter="surr_north",
    NameFilter="*",
    SublayerFiltering=True,
    TypeFilter=1073741848)
pipeline_9 = GeometryPipeline(
    GroupByLayer=False,
    GroupByType=False,
    IncludeHidden=True,
    IncludeLocked=True,
    LayerFilter="Balkongstaket",
    NameFilter="*",
    SublayerFiltering=True,
    TypeFilter=1073741848)
pipeline_10 = GeometryPipeline(
    GroupByLayer=False,
    GroupByType=False,
    IncludeHidden=True,
    IncludeLocked=True,
    LayerFilter="Balkong",
    NameFilter="*",
    SublayerFiltering=True,
    TypeFilter=1073741848)
merge_2 = Merge(
    Data1=pipeline_3,
    Data2=pipeline_7,
    Data3=pipeline_6,
    Data4=pipeline_4,
    Data5=pipeline_5,
    Data6=pipeline_8,
    Data7=pipeline_10,
    Data8=pipeline_9)

# ----
# Add legend
panel_4 = Panel("0")
legendpar = LBLegendParameters(min=panel_4, max="12", seg_count="13")  # -> leg_par; plug-in component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

# ----
# Compute direct sun hours
# for sets of gridpoints
# Click to execute simulation!
number_slider = Slider(0.1, range=0..1)
context = Brep(merge_2)
directsunhours = LBDirectSunHours(
    vectors=flatten(sunpath.vectors),
    timestep="2",
    geometry=flatten(geometry),
    context=flatten(context),
    grid_size=Slider(0.1, range=0..1),
    offset_dist=number_slider,
    legend_par=legendpar,
    run=Toggle(False))  # -> report, points, results, mesh, legend, title, int_mtx; plug-in component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

# ----
# Set the resolution for the
# displayed results
number_slider_2 = Slider(0.199, range=0..1)
pt = Point(directsunhours.points)
points = PointList(Points=pt, Size=number_slider_2)

# ----
# Simulation output for 21st of March
# (direct sun hours per gridpoint)
panel_5 = Panel(directsunhours.points)
panel_6 = Panel(directsunhours.results)
